# Grasshopper definition ReadJsonAndCreateGeometry_3a.gh (Grasshopper 1.0.7)
# plug-ins: Pufferfish, Speckle 2, Kangaroo2 Components, Human, LunchBox

list = ValueList({"select single item (Wall panel)": 0, "select multiple items (Wall panel)": 1}, selected="select multiple items (Wall panel)")
path = FilePath("C:\Users\panz\Documents\GitHub\IBC\05_Flooplan_processing_ve0_1\jsonExports\apartment.json")
path_2 = FilePath("C:\Users\panz\Documents\GitHub\IBC\05_Flooplan_processing_ve0_1\jsonExports\apartment.json")
path_3 = FilePath("C:\Users\panz\Documents\GitHub\IBC\05_Flooplan_processing\jsonExports\panels_oneApt_EP_update1_withRoomOutlineEDITED.json")

# ---- group: KEMPS_JSON_test FILE
path_4 = FilePath("C:\Users\panz\Documents\GitHub\IBC\05_Flooplan_processing\jsonExports\panels_oneApt_EP_update1_withRoomOutlineEDITED.json")

# ----
path_5 = FilePath("C:\Users\panz\Downloads\12005.json")
path_6 = FilePath("C:\Users\panz\Downloads\12005_snapped.json")
select_item = Slider(44, range=0..46)
path_7 = FilePath("C:\Users\panz\Downloads\floorplan.json")  # disabled
list_2 = ValueList({"originalFile": 0, "snappedFile": 1}, selected="originalFile")
list_3 = ValueList({"originalFile": 0, "snappedFile": 1}, selected="snappedFile")

# ---- group: hackathon_test FILE
path_8 = FilePath(path_7)  # disabled

# ----
series = Series(Start=0, Step=1, Count=select_item)
filter = StreamFilter(Gate=list_3, Stream0=path_5, Stream1=path_6)
filter_2 = StreamFilter(Gate=list_2, Stream0=path_5, Stream1=path_6)

python = GhPythonScript(file=path_8)  # -> out, apartmentNames, roomTypes, roomPolylines, roomSurfaces, roomColors; disabled
# ---------- python: Python ----------
__author__ = "panz"
__version__ = "2024.11.11"

import rhinoscriptsyntax as rs
import json
import json
import Rhino.Geometry as rg

# Read and parse JSON data from the file
with open(file, 'r') as inputfile:
    data = json.load(inputfile)

# Extract panels (walls) data
panels_data = data.get("panels", {}).get("items", {})
if not panels_data:
    print("Warning: 'panels.items' key is missing or empty in JSON.")
    
# Extract apartment outlines from 'spaces'
spaces_data = data.get("spaces", {})
roomOutlines = []
roomPolylines =[]
apartmentNames = []
roomTypes = []
roomColors = []
roomSurfaces = []

for space_id, space in spaces_data.items():
    coordinates = space.get("coordinates")
    roomTypes.append(space.get("room_type"))
    apartmentNames.append(space.get("apartment"))
    outline_points = [[point["x"], point["y"], point["z"]] for point in coordinates]
    roomOutlines.append(outline_points)
print (len(roomOutlines))


roomCounter = 0 
for index in range (0, len(spaces_data)):
    roomOutline = roomOutlines[index] 
    
    # Convert the point lists into Rhino Point3d objects
    polyline_points = [rg.Point3d(point[0], point[1], point[2]) for point in roomOutline]
    # Create the polyline using the list of Point3d objects
    polyline = rg.Polyline(polyline_points)
    
    
    #assign colors based on roomput
    if (roomTypes[index] == "living_room"):
        roomColors.append('255,100,0')
    elif (roomTypes[index] == "bedroom"):
        roomColors.append('153,137,255')
    elif (roomTypes[index] == "kitchen"):
        roomColors.append('0,0,220')
    elif (roomTypes[index] == "bathroom"):
        roomColors.append('151,255,255')
    elif (roomTypes[index] == "core"):
        roomColors.append('150,150,150')
        
    # create a surface
    roomSrfs = rg.Brep.CreatePlanarBreps(polyline.ToNurbsCurve())
    roomSurfaces.append(roomSrfs[0])
    # Ensure the polyline is closed if necessary (optional)
    if not polyline.IsClosed:
        polyline.Add(polyline[0])  # Add the first point to close the polyline
    # Output the polyline (e.g., to Grasshopper)
    roomPolylines.append(polyline)
    roomCounter +=1 
    print ("created", roomCounter, "space polylines")
    print(roomSurfaces)
# ---------- end python ----------
crv = Curve(python.roomPolylines)  # disabled
brep = Brep(python.roomSurfaces)  # disabled

number_slider = Slider(1, range=0..10)  # disabled
series_2 = Series(Start=0, Step=1, Count=number_slider)  # disabled
item = ListItem(List=crv, Index=series_2, Wrap=True)  # disabled

filter_3 = StreamFilter(Gate=list, Stream0=select_item, Stream1=series)
panel = Panel(path_8)  # disabled

# ----
# GET WALL PROPERTIES
python_2 = GhPythonScript(file=filter_2, panelIndex=filter_3)  # -> out, PanelType, StartPoint, EndPoint, Height, Thickness, RoomType, ApartmentName; inputs panelIndex: Int32
# ---------- python_2: Python ----------
__author__ = "panz"
__version__ = "2024.11.11"

import rhinoscriptsyntax as rs
import json
import json
import Rhino.Geometry as rg

# Read and parse JSON data from the file
with open(file, 'r') as inputfile:
    data = json.load(inputfile)

# Extract panel information
panels = data["panels"]["items"]
if not panels:
    print("Warning: 'panels.items' key is missing or empty in JSON.")
    
# Extract apartment outlines from 'spaces'
spaces_data = data.get("spaces", {})


# Initialize lists to store panel data
panel_types = []
start_points = []
end_points = []
heights = []
thicknesses = []
roomTypes = []
apartmentNames = []



# Loop through each panel and extract relevant information
for key, panel in panels.items():
    panel_types.append(panel.get("panel_type"))
    start_points.append(panel.get("start_point"))
    end_points.append(panel.get("end_point"))
    heights.append(panel.get("height"))
    thicknesses.append(panel.get("thickness"))
    roomTypes.append(panel.get("room"))
    apartmentNames.append(panel.get("apartment", "N/A"))          # Default: "N/A"


# Assume 'index' is passed as an argument (in a Grasshopper environment, for example)

PanelType = panel_types[panelIndex]
StartPoint = start_points[panelIndex]
EndPoint = end_points[panelIndex]
Height = heights[panelIndex]
Thickness = thicknesses[panelIndex]
RoomType = roomTypes[panelIndex]
ApartmentName = apartmentNames[panelIndex]



print("Panel Type:", PanelType)
print("Start Point:", StartPoint)
print("End Point:", EndPoint)
print("Height:", Height)
print("Thickness:", Thickness)
print("Room Type:", RoomType)
print("Apartment:", ApartmentName)
# ---------- end python_2 ----------

# ----
# GET WALL PROPERTIES
python_3 = GhPythonScript(file=filter, panelIndex=filter_3)  # -> out, PanelType, StartPoint, EndPoint, Height, Thickness, RoomType, ApartmentName; inputs panelIndex: Int32; same code as python_2

number_slider_2 = Slider(0.1, range=0.1..100)  # disabled
number_slider_3 = Slider(500, range=0..10000)  # disabled
crv_2 = Curve(item)  # disabled
brec = BoundingRectangle(Geometry=crv, Plane=PlaneXY(0, 0, 0), Axis=0, Slide=0, Union=True)  # -> Bounding, DimensionX, DimensionY; disabled
pt = Point(Point(0, 0, 0))  # disabled
explode = Explode(Curve=brec.Bounding, Recursive=True)  # -> Segments, Vertices; disabled
recgrid = Rectangular(Plane=pt, SizeX=number_slider_2, SizeY=number_slider_2, ExtentX=number_slider_3, ExtentY=number_slider_3)  # -> Cells, Points; disabled
item_2 = ListItem(List=explode.Vertices, Index=0, Wrap=True)  # disabled
move2pt = MoveToPoint(Geometry=recgrid.Cells, PointA=pt, PointB=item_2)  # -> Moved, Vector, Transform; disabled
pcen = PolygonCenter(Polyline=move2pt.Moved)  # -> CenterV, CenterE, CenterA; disabled
incurves = PointInCurves(Point=pcen.CenterV, Curves=crv_2)  # -> Relationship, Index, Point; disabled
panel_2 = Panel("1")  # disabled
panel_3 = Panel("2")  # disabled
panel_4 = Panel(incurves.Relationship)  # disabled
equals = Equality(FirstNumber=incurves.Relationship, SecondNumber=panel_3)  # -> Equality, Inequality; disabled
equals_2 = Equality(FirstNumber=incurves.Relationship, SecondNumber=panel_2)  # -> Equality, Inequality; disabled
cull = CullPattern(List=move2pt.Moved, CullPattern=equals.Equality)  # -> flatten(List); disabled
or = GateOr(A=equals_2.Equality, B=equals.Equality)  # disabled

number_slider_4 = Slider(12, range=0..12)  # disabled

number_slider_5 = Slider(12, range=0..12)  # disabled
item_3 = ListItem(List=crv, Index=number_slider_4, Wrap=True)  # disabled
series_3 = Series(Start=0, Step=1, Count=number_slider_5)  # disabled
explode_2 = Explode(Curve=item_3, Recursive=True)  # -> Segments, Vertices; disabled
strainghten_poly_lin = StrainghtenPolyLin(vec=explode_2.Segments, pt=explode_2.Vertices)  # disabled

# ---- group: tags
show_room_labels = BooleanToggle(True)  # disabled
room_label_height = Slider(9, range=0..30)  # disabled
room_label_size = Slider(0.265, range=0..50)  # disabled
room_labler_color = ColourSwatch(SwatchColor=RGB(0, 255, 0))  # disabled
area = Area(Geometry=crv)  # -> Area, Centroid; disabled
Z = UnitZ(Factor=room_label_height)  # disabled
move = Move(Geometry=area.Centroid, Motion=Z)  # -> Geometry, Transform; disabled
panel_5 = Panel("")  # disabled
panel_6 = Panel(":")  # disabled
panel_7 = Panel(" m2")  # disabled
concat = Concatenate(
    FragmentE=python.apartmentNames,
    FragmentF=panel_5,
    FragmentA=python.roomTypes,
    FragmentC=panel_6,
    FragmentB=area.Area,
    FragmentD=panel_7)  # disabled
ln = Line(StartPoint=area.Centroid, EndPoint=move.Geometry)  # disabled
gate = StreamGate(Stream=move.Geometry, Gate=show_room_labels)  # -> Target0, Target1; disabled
gate_2 = StreamGate(Stream=ln, Gate=show_room_labels)  # -> Target0, Target1; disabled
tag = TextTag3D(Location=gate.Target1, Text=flatten(concat), Size=room_label_size, Colour=room_labler_color, Justification=5)  # disabled
preview = CustomPreview(Geometry=brep, Material=python.roomColors)  # disabled
preview_2 = CustomPreview(Geometry=gate_2.Target1, Material=room_labler_color)  # disabled

# ----
item_4 = ListItem(List=python_2.StartPoint, Index=0, Wrap=True)  # -> Item, Item1, Item2
item_5 = ListItem(List=python_2.EndPoint, Index=0, Wrap=True)  # -> Item, Item1, Item2
Z_2 = UnitZ(Factor=python_2.Height)
pt_2 = ConstructPoint(XCoordinate=item_5.Item, YCoordinate=item_5.Item1, ZCoordinate=item_5.Item2)
pt_3 = ConstructPoint(XCoordinate=item_4.Item, YCoordinate=item_4.Item1, ZCoordinate=item_4.Item2)
division = Division(A=python_2.Thickness, B=2)
ln_2 = Line(StartPoint=pt_3, EndPoint=pt_2)
offcrv = OffsetCurve(Curve=ln_2, Plane=PlaneXY(0, 0, 0), Distance=graft(division), BothSides=True, Kinks=0, CapType=1)

item_6 = ListItem(List=python_3.StartPoint, Index=0, Wrap=True)  # -> Item, Item1, Item2
item_7 = ListItem(List=python_3.EndPoint, Index=0, Wrap=True)  # -> Item, Item1, Item2
Z_3 = UnitZ(Factor=python_3.Height)
pt_4 = ConstructPoint(XCoordinate=item_7.Item, YCoordinate=item_7.Item1, ZCoordinate=item_7.Item2)
pt_5 = ConstructPoint(XCoordinate=item_6.Item, YCoordinate=item_6.Item1, ZCoordinate=item_6.Item2)
division_2 = Division(A=python_3.Thickness, B=2)
ln_3 = Line(StartPoint=pt_5, EndPoint=pt_4)
offcrv_2 = OffsetCurve(Curve=ln_3, Plane=PlaneXY(0, 0, 0), Distance=graft(division_2), BothSides=True, Kinks=0, CapType=1)

number_slider_6 = Slider(1, range=0..10)  # disabled
series_4 = Series(Start=0, Step=1, Count=number_slider_6)  # disabled
bake = ObjectBake(
    BakeToggle=number_slider_5,
    GeometryObjects=strainghten_poly_lin,
    Layer="GH_Bake",
    ObjectName="GH_Obj",
    ObjectColor=RGB(255, 255, 255),
    LayerColor=RGB(255, 255, 255))  # disabled
item_8 = ListItem(List=crv, Index=series_4, Wrap=True)  # disabled

number_slider_7 = Slider(4, range=0..5)  # disabled
boundary = BoundarySurfaces(Edges=crv)  # disabled
series_5 = Series(Start=0, Step=1, Count=number_slider_7)  # disabled
item_9 = ListItem(List=crv, Index=series_5, Wrap=True)  # disabled
brec_2 = BoundingRectangle(Geometry=item_9, Plane=PlaneXY(0, 0, 0), Axis=0, Slide=0, Union=True)  # -> Bounding, DimensionX, DimensionY; disabled
boundary_2 = BoundarySurfaces(Edges=brec_2.Bounding)  # disabled
pull = PullCurve(Curve=item_9, Surface=boundary_2)  # disabled

extr = Extrude(Base=offcrv, Direction=graft(Z_2))  # disabled
cap = CapHoles(Brep=extr)  # disabled
brep_2 = Brep(flatten(cap))  # disabled
debrep = DeconstructBrep(Brep=brep_2)  # -> Faces, Edges, Vertices; disabled
area_2 = Area(Geometry=debrep.Faces)  # -> Area, Centroid; disabled
sort = SortList(Keys=area_2.Area, ValuesA=debrep.Faces)  # -> Keys, reverse(ValuesA), ValuesB; disabled
item_10 = ListItem(List=sort.Keys, Index=0, Wrap=True)  # disabled

number_slider_8 = Slider(4.41, range=0..8)  # disabled
swatch = ColourSwatch(SwatchColor=RGB(247, 0, 0))  # disabled
previewlw = CustomPreviewLineweights(Geometry=item_3, Shader=swatch, Thickness=number_slider_8, Absolute=False)  # disabled

element_label_height = Slider(3, range=0..30)
show_info = BooleanToggle(True)
element_label_size = Slider(0.183, range=0..50)
element_label_color = ColourSwatch(SwatchColor=RGB(3, 3, 3))
addition = Addition(A=element_label_height, B=3)
dom = ConstructDomain(DomainStart=element_label_height, DomainEnd=addition)

number_slider_9 = Slider(8, range=0..8)  # disabled
swatch_2 = ColourSwatch(SwatchColor=RGB(0, 247, 41))  # disabled
previewlw_2 = CustomPreviewLineweights(Geometry=strainghten_poly_lin, Shader=swatch_2, Thickness=number_slider_9, Absolute=False)  # disabled

# ---- group: METHOD B
explode_3 = Explode(Curve=item_8, Recursive=True)  # -> Segments, Vertices; disabled
panel_8 = Panel("0")  # disabled
panel_9 = Panel("90")  # disabled
rad = Radians(Degrees=panel_9)  # disabled
rad_2 = Radians(Degrees=panel_8)  # disabled
runion = RegionUnion(Curves=cull)  # disabled
number_slider_10 = Slider(1, range=1..1000)  # disabled
or_2 = GateOr(A=rad, B=rad_2)  # disabled
number_slider_11 = Slider(1, range=1..1000)  # disabled
number_slider_12 = Slider(637, range=1..1000)  # disabled
shift = ShiftList(List=explode_3.Segments, Shift=1, Wrap=False)  # disabled
explode_4 = Explode(Curve=runion, Recursive=True)  # -> Segments, Vertices; disabled
length_line = LengthLine(Line=explode_3.Segments, Strength=number_slider_10)  # disabled
angle = Angle(LineA=explode_3.Segments, LineB=shift, RestAngle=or_2, Strength=number_slider_11)  # disabled
anchor = Anchor(Point=explode_4.Vertices, Strength=number_slider_12)  # disabled
button = Button()  # disabled
bouncysolver = BouncySolver(
    GoalObjects=[length_line, angle, anchor],
    Reset=button,
    Threshold=1e-15,
    Tolerance=0.0001,
    Damping=0.99,
    Iterations=10,
    On=True)  # -> I, V, O; disabled

# ----
previewlw_3 = CustomPreviewLineweights(Geometry=ln_2, Shader=ColourSwatch(SwatchColor=RGB(247, 0, 0)), Thickness=Slider(4.41, range=0..8), Absolute=False)

previewlw_4 = CustomPreviewLineweights(Geometry=ln_3, Shader=ColourSwatch(SwatchColor=RGB(0, 247, 41)), Thickness=Slider(8, range=0..8), Absolute=False)

eval = EvaluateCurve(Curve=reparameterize(ln_2), Parameter="0.5")  # -> Point, Tangent, Angle
lng = ListLength(List=eval.Point)
random = Random(Range=dom, Number=lng, Seed=2)
concat_2 = Concatenate(FragmentB=python_2.RoomType, FragmentE=python_2.PanelType)
Z_4 = UnitZ(Factor=random)
panel_10 = Panel(concat_2)
move_2 = Move(Geometry=eval.Point, Motion=Z_4)  # -> Geometry, Transform
ln_4 = Line(StartPoint=eval.Point, EndPoint=move_2.Geometry)
gate_3 = StreamGate(Stream=move_2.Geometry, Gate=show_info)  # -> Target0, Target1
gate_4 = StreamGate(Stream=ln_4, Gate=show_info)  # -> Target0, Target1
tag_2 = TextTag3D(Location=gate_3.Target1, Text=graft(panel_10), Size=element_label_size, Colour=element_label_color, Justification=8)
preview_3 = CustomPreview(Geometry=gate_4.Target1, Material=element_label_color)

# ---- group: Porject_information
cso = CreateSpeckleObject(Name="IBC-Building", selectedKitName="Objects")
cso_2 = CreateSpeckleObject(Name="Implenia_Default", selectedKitName="Objects")
cso_3 = CreateSpeckleObject(Name="Implenia_Default", selectedKitName="Objects")
eso = ExtendSpeckleObject(
    SpeckleObject=cso,
    Building_ID=cso_3,
    Level_ID=cso_2,
    Building_Use="Implenia_Default",
    Building_phase="tbd",
    selectedKitName="Objects")
panel_11 = Panel("In Progress")

# ----
level = Level(
    Name="Level 0",
    Elevation="0",
    SelectedConstructorName="Objects.BuiltElements.Level.ctor(System.String,System.Double)",
    SelectedTypeName="Objects.BuiltElements.Level",
    UseSchemaTag=False,
    UserSetSchemaTag=False,
    seed="d38af342d870281b8f9e")

crv_3 = Curve(crv)
Z_5 = UnitZ(Factor="-0.15")
boundary_3 = BoundarySurfaces(Edges=crv_3)
floor = Floor(
    Outline=crv_3,
    Family="Floor",
    A=boundary_3,
    SelectedConstructorName="Objects.BuiltElements.Floor.ctor(Objects.ICurve,System.Collections.Generic.List`1[Objects.ICurve],System.Collections.Generic.List`1[Speckle.Core.Models.Base])",
    SelectedTypeName="Objects.BuiltElements.Floor",
    UseSchemaTag=False,
    UserSetSchemaTag=False,
    seed="5cc5e3f46eed33223d9a")
extr_2 = Extrude(Base=boundary_3, Direction=Z_5)

# ---- group: wall_parameters
cso_4 = CreateSpeckleObject(Name_EN="Implenia Slab", selectedKitName="Objects")
eso_2 = ExtendSpeckleObject(SpeckleObject=cso_4, Is_External="FALSE", UValue="1.0", selectedKitName="Objects")

# ----
# CLICK TO SELECT AND
# SEND ASSEMBLIES TO SPECKLE
panel_12 = Panel(python_2.PanelType)
# You could replicate this type of structure in Speckle like so 👇
# 
# Conceptual building using nested speckle objects to organise, categorise and label the data.
# 
# If you receive this structure from someone else, you just need to expand it until you reach the data you need 👇🏼
# 
# Doing the inverse operation: starting from the "building" and expanding down to the unit values.
panel_13 = Panel(python_2.Height)
list_4 = Accounts(
    {"No account selected": , "Account (panz@zhaw.ch | https://app.speckle.systems)": "https://app.speckle.systems/?id=7b59e40123", "Account (vague@topotheque.com | https://app.speckle.systems)": "https://app.speckle.systems/?id=d442476304"}, selected="Account (panz@zhaw.ch | https://app.speckle.systems)",
    FirstSelectedItem="https://app.speckle.systems/?id=7b59e40123")
panel_14 = Panel("https://app.speckle.systems/projects/b9d01cae98/models/2a663449ba")
message = Panel("testing export walls")
sget = StreamGet(StreamIDURL=panel_14, SpeckleAccount=list_4)

# ---- group: WALL object
rendermaterial = RenderMaterial(
    Opacity=1,
    Metalness=0,
    Roughness=1,
    SelectedConstructorName="Objects.Other.RenderMaterial.ctor(System.Double,System.Double,System.Double,System.Nullable`1[System.Drawing.Color],System.Nullable`1[System.Drawing.Color])",
    SelectedTypeName="Objects.Other.RenderMaterial",
    UseSchemaTag=False,
    UserSetSchemaTag=False,
    seed="6f203a072cfea5a7e1e1")
cso_5 = CreateSpeckleObject(Wall_geometry=brep_2, selectedKitName="Objects")
wall = Wall(
    Height=python_2.Height,
    BaseLine=flatten(ln_2),
    Thickness=python_2.Thickness,
    Level=level,
    NumberCode=panel_12,
    ProjectInformation=eso,
    Surface=flatten(item_10),
    Material=rendermaterial,
    A=cso_5,
    SelectedConstructorName="Objects.BuiltElements.Wall.ctor(System.Double,Objects.ICurve,System.Collections.Generic.List`1[Speckle.Core.Models.Base])",
    SelectedTypeName="Objects.BuiltElements.Wall",
    UseSchemaTag=False,
    UserSetSchemaTag=True,
    seed="a3bcf4127012e3fe4be9")  # -> flatten(SpeckleObject)

# ---- group: REVIT_Wall
sso = RevitWallByCurveAndHeight(
    Family=panel_12,
    Type="Implenia_wall",
    BaseLine=ln_2,
    Level=level,
    Height=python_2.Height,
    BaseOffset=0,
    TopOffset=0,
    Flipped=False,
    Structural=False,
    Thickness=python_2.Thickness,
    SelectedConstructorName="Objects.BuiltElements.Revit.RevitWall.ctor(System.String,System.String,Objects.ICurve,Objects.BuiltElements.Level,System.Double,System.Double,System.Double,System.Boolean,System.Boolean,System.Collections.Generic.List`1[Speckle.Core.Models.Base],System.Collections.Generic.List`1[Objects.BuiltElements.Revit.Parameter])",
    SelectedTypeName="Objects.BuiltElements.Revit.RevitWall",
    UseSchemaTag=False,
    UserSetSchemaTag=False,
    seed="73301769be48de9a2ede")

# ----
eso_3 = ExtendSpeckleObject(
    SpeckleObject=extr_2,
    Type="SLA_21",
    Category="SLAB",
    Outline=crv_3,
    Thickness="-0.15",
    Level=level,
    ProjectInformation=eso,
    ElementInformation=eso_2,
    selectedKitName="Objects")  # -> flatten(ExtendedSpeckleObject)
eso_4 = ExtendSpeckleObject(
    SpeckleObject=brep_2,
    Type=panel_12,
    Category="Walls",
    Baseline=ln_2,
    Thickness=python_2.Thickness,
    Level=level,
    ApartmentName=python_2.RoomType,
    RoomName=python_2.RoomType,
    RoomHeight=panel_13,
    ProjectInformation=eso,
    ElementInformation=eso_2,
    selectedKitName="Objects")  # -> flatten(ExtendedSpeckleObject)
cso_6 = CreateSpeckleObject(Floors=eso_3, Walls=eso_4, selectedKitName="Objects")

send = Send(
    Stream=sget,
    Message=message,
    Data=cso_6,
    AutoSend=False,
    BaseId="251fe3be066f2a7fd52ae77e43311b4d",
    CurrentComponentState="expired",
    KitName="Objects",
    OutputWrappers="https://app.speckle.systems\tb9d01cae98\t0227d45a21",
    UseDefaultCache=True,
    selectedKitName="Objects")

# ==== cluster StrainghtenPolyLin
vec = ClusterInput()
pt = ClusterInput()
vec_2 = Vector(vec)
pt_2 = Point(pt)
pt_3 = Point(pt)
devec = DeconstructVector(Vector=vec_2)  # -> XComponent, YComponent, ZComponent
lng = ListLength(List=pt_2)
round = Round(Number=devec.XComponent)  # -> Nearest, Floor, Ceiling
round_2 = Round(Number=devec.YComponent)  # -> Nearest, Floor, Ceiling
round_3 = Round(Number=devec.ZComponent)  # -> Nearest, Floor, Ceiling
culln = CullNth(List=pt_3, CullFrequency=lng)
vec_3 = VectorXYZ(XComponent=round.Nearest, YComponent=round_2.Nearest, ZComponent=round_3.Nearest)  # -> Vector, Length
number_slider = Slider(66, range=1..100)
line = LineSDL(Start=culln, Direction=vec_3.Vector, Length="1")
ext = ExtendCurve(Curve=line, Type=0, Start=number_slider, End=number_slider)
ccx = CurveCurve(CurveA=ext, CurveB=graft(ext))  # -> Points, ParamsA, ParamsB
cp = ClosestPoint(Point=pt_3, Cloud=flatten(ccx.Points))  # -> ClosestPoint, CPIndex, Distance
pline = PolyLine(Vertices=cp.ClosestPoint, Closed=False)
pl = ClusterOutput(pline)
