# Grasshopper definition ReadParseJson_Designs.gh (Grasshopper 1.0.7)

candidate_design = ValueList({"candidate 11001": 0, "candidate 12001": 1, "candidate 12005": 2, "candidate 12009": 3, "candidate 14007": 4, "candidate 14012": 5, "candidate 18003": 6, "candidate 21004": 7}, selected="candidate 21004")
path = FilePath("C:\Users\panz\Documents\GitHub\2025-AEC-Hackathon\json\GenericDesign_12001\12001.json")
path_2 = FilePath("C:\Users\panz\Documents\GitHub\2025-AEC-Hackathon\json\GenericDesign_11001\11001.json")
path_3 = FilePath("C:\Users\panz\Documents\GitHub\2025-AEC-Hackathon\json\GenericDesign_12005\12005.json")
path_4 = FilePath("C:\Users\panz\Documents\GitHub\2025-AEC-Hackathon\json\GenericDesign_14012\14012.json")
path_5 = FilePath("C:\Users\panz\Documents\GitHub\2025-AEC-Hackathon\json\GenericDesign_12009\12009.json")
path_6 = FilePath("C:\Users\panz\Documents\GitHub\2025-AEC-Hackathon\json\GenericDesign_14007\14007.json")
path_7 = FilePath("C:\Users\panz\Documents\GitHub\2025-AEC-Hackathon\json\GenericDesign_18003\18003.json")
path_8 = FilePath("C:\Users\panz\Documents\GitHub\2025-AEC-Hackathon\json\GenericDesign_21004\21004.json")
number_slider = Slider(0, range=0..7)
filter = StreamFilter(
    Gate=candidate_design,
    Stream0=path_2,
    Stream1=path,
    Stream2=path_3,
    Stream3=path_5,
    Stream4=path_6,
    Stream5=path_4,
    Stream6=path_7,
    Stream7=path_8)
python = GhPythonScript(file=filter)  # -> out, apartmentNames, roomTypes, roomPolylines, roomSurfaces, roomColors, adjacencies
# ---------- python: Python ----------
__author__ = "panz"
__version__ = "2024.11.11"

import rhinoscriptsyntax as rs
import json
import json
import Rhino.Geometry as rg

# Read and parse JSON data from the file
with open(file, 'r') as inputfile:
    data = json.load(inputfile)

# Extract panels (walls) data
panels_data = data.get("panels", {}).get("items", {})
if not panels_data:
    print("Warning: 'panels.items' key is missing or empty in JSON.")
    
    


# Extract apartment outlines from 'spaces'
spaces_data = data.get("spaces", {})
roomOutlines = []
roomPolylines =[]
apartmentNames = []
roomTypes = []
roomColors = []
roomSurfaces = []

for space_id, space in spaces_data.items():
    coordinates = space.get("coordinates")
    roomTypes.append(space.get("room_type"))
    apartmentNames.append(space.get("apartment"))
    outline_points = [[point["x"], point["y"], point["z"]] for point in coordinates]
    roomOutlines.append(outline_points)
print (len(roomOutlines))


roomType = "bathroom"

#get adjacencies
adjacencies =[]
#adjacency_data =data.get("room_adjacency").get(roomType)
adjacency_data =data.get("room_adjacency")
adjacencies = adjacency_data
print (adjacency_data) 



roomCounter = 0 
for index in range (0, len(spaces_data)):
    roomOutline = roomOutlines[index] 
    
    # Convert the point lists into Rhino Point3d objects
    polyline_points = [rg.Point3d(point[0], point[1], point[2]) for point in roomOutline]
    # Create the polyline using the list of Point3d objects
    polyline = rg.Polyline(polyline_points)
    
    
    #assign colors based on roomput
    if (roomTypes[index] == "living_room"):
        roomColors.append('255,100,0')
    elif (roomTypes[index] == "bedroom"):
        roomColors.append('153,137,255')
    elif (roomTypes[index] == "kitchen"):
        roomColors.append('0,0,220')
    elif (roomTypes[index] == "bathroom"):
        roomColors.append('151,255,255')
    elif (roomTypes[index] == "core"):
        roomColors.append('150,150,150')
        
    # create a surface
    roomSrfs = rg.Brep.CreatePlanarBreps(polyline.ToNurbsCurve())
    roomSurfaces.append(roomSrfs[0])
    # Ensure the polyline is closed if necessary (optional)
    if not polyline.IsClosed:
        polyline.Add(polyline[0])  # Add the first point to close the polyline
    # Output the polyline (e.g., to Grasshopper)
    roomPolylines.append(polyline)
    roomCounter +=1 
    #print ("created", roomCounter, "space polylines")
    #print(roomSurfaces)
# ---------- end python ----------
panel = Panel(python.roomTypes)
area = Area(Geometry=python.roomSurfaces)  # -> Area, Centroid
crv = Curve(python.roomPolylines)
tag = TextTag(Location=area.Centroid, Text=panel)
rec = DataRecorder(crv, DataLimit=-10, RecordData=True)
rec_2 = DataRecorder(panel, DataLimit=-10, RecordData=True)

reference_design = ValueList({"reference design 01": 0, "reference design 02": 1}, selected="reference design 01")
path_9 = FilePath("C:\Users\panz\Documents\GitHub\2025-AEC-Hackathon\json\ReferenceDesign_01\Reference01.json")
path_10 = FilePath("C:\Users\panz\Documents\GitHub\2025-AEC-Hackathon\json\ReferenceDesign_02\Reference02.json")
filter_2 = StreamFilter(Gate=reference_design, Stream0=path_9, Stream1=path_10)
python_2 = GhPythonScript(file=filter_2)  # -> out, apartmentNames, roomTypes, roomPolylines, roomSurfaces, roomColors, adjacencies; same code as python
panel_2 = Panel(python_2.roomTypes)
area_2 = Area(Geometry=python_2.roomSurfaces)  # -> Area, Centroid
crv_2 = Curve(python_2.roomPolylines)
tag_2 = TextTag(Location=area_2.Centroid, Text=panel_2)
rec_3 = DataRecorder(panel_2, DataLimit=-10, RecordData=True)
rec_4 = DataRecorder(crv_2, DataLimit=-10, RecordData=True)
panel_3 = Panel(rec_3)

# ----
# candidate 21004
txt = Text(["bedroom", "bathroom", "bathroom", "bedroom", "core", "living_room", "bedroom", "bedroom", "bedroom", "living_room", "bedroom", "bathroom", "bedroom"])
panel_4 = Panel(txt)
crv_3 = Curve([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])

txt_2 = Text(["living_room", "bedroom", "bathroom", "core", "corridor", "bathroom", "living_room", "bathroom", "bedroom", "bedroom", "bathroom", "corridor", "core", "bedroom", "bedroom", "bathroom", "living_room", "bathroom", "bathroom", "corridor", "corridor", "living_room", "bedroom", "corridor", "kitchen"])

# ----
# reference design 02
crv_4 = Curve([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])
panel_5 = Panel(txt_2)

txt_3 = Text(["living_room", "bedroom", "bathroom", "core", "corridor", "bathroom", "living_room", "bathroom", "bedroom", "bedroom", "bathroom", "corridor", "core", "bedroom", "bedroom", "bathroom", "living_room", "bathroom", "bathroom", "corridor", "corridor", "living_room", "bedroom", "corridor", "kitchen", "living_room", "bedroom", "bathroom", "core", "corridor", "bathroom", "living_room", "bathroom", "bedroom", "bedroom", "bathroom", "corridor"])
txt_4 = Text(["corridor", "bedroom", "living_room", "bedroom", "bathroom", "bathroom", "bedroom", "bedroom", "core"])

# ----
# reference design 01
crv_5 = Curve([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])
panel_6 = Panel(txt_3)

# ----
# candidate 14012
txt_5 = Text(["bedroom", "bathroom", "corridor", "core", "bathroom", "bedroom", "bedroom", "bedroom", "living_room"])
crv_6 = Curve([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])
panel_7 = Panel(txt_5)

# ----
# candidate 12005
txt_6 = Text(["living_room", "bathroom", "core", "bedroom", "bedroom", "bedroom", "bedroom"])
crv_7 = Curve([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])

txt_7 = Text(["bathroom", "bedroom", "core", "corridor", "living_room", "bathroom", "bedroom", "bedroom"])

# ----
# candidate 12009
txt_8 = Text(["living_room", "corridor", "core", "bedroom", "bedroom", "bathroom", "bathroom"])
crv_8 = Curve([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])

# ----
# candidate 12001
txt_9 = Text(["bathroom", "bedroom", "bedroom", "bedroom", "living_room", "core", "bathroom", "bedroom", "corridor", "bedroom"])
crv_9 = Curve([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])
panel_8 = Panel(txt_9)

# ----
# candidate 11001
crv_10 = Curve([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])
panel_9 = Panel(txt_7)

# ----
# candidate 14007
crv_11 = Curve([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])
txt_10 = Text(["living_room", "bedroom", "core", "bedroom", "bedroom", "bathroom", "bathroom"])
panel_10 = Panel(txt_10)

# ----
# candidate 18003
crv_12 = Curve([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])
panel_11 = Panel(txt_4)
