# Grasshopper definition GraphTestSpiderWeb.gh (Grasshopper 1.0.7)
# plug-ins: SipderWeb, ShapeDiverForGrasshopper, Human

sddp = ShapeDiverDocumentPayload({AbsoluteTolerance=0, AngleTolerance=0, DistanceDisplayPrecision=0, GltfVersion="Gltf2", GrasshopperVersion="1.0.0007", InputGroups="{}", OutputGroups="{}", RelativeTolerance=0, RhinoVersion="7.37.24107.15001", UnitSystem=0, VersionCreated="1.22.0.0", VersionSaved="1.22.0.0"})

# ----
# reference design 01
crv = Curve([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])
txt = Text(["living_room", "bedroom", "bathroom", "core", "corridor", "bathroom", "living_room", "bathroom", "bedroom", "bedroom", "bathroom", "corridor"])
panel = Panel(txt)

list = ValueList({"floorplan": 0, "floorplan": 1}, selected="floorplan")
txt_2 = Text(["bathroom", "bedroom", "core", "corridor", "living_room", "bathroom", "bedroom", "bedroom"])

# ----
# candidate 11001
crv_2 = Curve([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])
panel_2 = Panel(txt_2)

filter = StreamFilter(Gate=list, Stream0=txt, Stream1=txt_2)
filter_2 = StreamFilter(Gate=list, Stream0=crv, Stream1=crv_2)
area = Area(Geometry=filter_2)  # -> Area, Centroid
graphfromcells = GraphFromCells(Cells=filter_2)  # -> Graph, GraphDistances, GraphVertex, Lines
tag = TextTag(Location=area.Centroid, Text=filter)
number_slider = Slider(1, range=0..10)
panel_3 = Panel(graphfromcells.GraphDistances)
python = GhPythonScript(roomType=filter, roomOutline=filter_2)  # -> out, a, indices
# ---------- python: Python ----------
__author__ = "panz"
__version__ = "2025.02.11"

import rhinoscriptsyntax as rs
roomOutline
focusOutlines = []
index = []
counter = 0

if (roomType== "bathroom" or roomType== "corridor" or roomType== "kitchen") :
    print ("found")
    focusOutlines.append(roomOutline)
    index.append(counter)
else:
    print("not found")
counter +=1
a = focusOutlines
indices = index
# ---------- end python ----------
sp = ShortestPath(Graph=graphfromcells.Graph, GraphDistances=graphfromcells.GraphDistances, StartPoints=number_slider)  # -> Distance, ShortestPathGraph
panel_4 = Panel(python.out)
item = ListItem(List=graphfromcells.GraphVertex, Index=number_slider, Wrap=True)
maxst = MaxST(Graph=sp.ShortestPathGraph, GraphDistance=graphfromcells.GraphDistances)  # -> MaxinmalSpanningTree, GraphDistances
area_2 = Area(Geometry=python.a)  # -> Area, Centroid
panel_5 = Panel(sp.Distance)

graphfrompoints = GraphFromPoints(GraphVertex=graphfromcells.GraphVertex, ConnectingDistance=Slider(3, range=0..10))  # -> Graph, GraphDistances, ConnectionLines
previewlw = CustomPreviewLineweights(
    Geometry=graphfrompoints.ConnectionLines,
    Shader={diffuse=RGB(255, 105, 180), emission=RGB(76, 32, 54), shine=0.5, specular=RGB(255, 255, 255), transparency=0},
    Thickness=Slider(4.008, range=0..6),
    Absolute=False)
panel_6 = Panel(graphfrompoints.GraphDistances)

panel_7 = Panel(sp.ShortestPathGraph)
swatch = ColourSwatch(SwatchColor=RGB(92, 0, 0))
len = Length(Curve=graphfromcells.Lines)
eval = EvaluateCurve(Curve=graphfromcells.Lines, Parameter=0.5)  # -> Point, Tangent, Angle
rndsgc = RandomizedSequentialGraphColoring(
    Graph=graphfromcells.Graph,
    MaximumItterations=Slider(46, range=0..100),
    AimedColors=ColourSwatch(SwatchColor=RGB(232, 0, 0)))
tag_2 = TextTag(Location=eval.Point, Text=len)
choicebetweenpoints = ChoiceBetweenPoints(
    Graph=graphfromcells.Graph,
    Distance=graphfromcells.Lines,
    GraphVertex=graphfromcells.GraphVertex,
    StartingPoints=area_2.Centroid,
    MaximalDetour=Slider(19.044, range=0..29))  # -> ChoiceBetweenPoints, ConnectionLines
preview = CustomPreview(Geometry=graphfromcells.Lines, Material=rndsgc)
panel_8 = Panel(choicebetweenpoints.ChoiceBetweenPoints)
