# Grasshopper definition 20250208_snap to grid.gh (Grasshopper 1.0.7)
# plug-ins: AECHackathon Implenia, Mesh Pipe, ShapeDiverForGrasshopper, Pufferfish, TT Toolbox

curve = Curve(<curve referenced from the Rhino model>)  # disabled
curve_2 = Curve(<curve referenced from the Rhino model>)  # disabled

curve_3 = Curve(curve)  # disabled
discontinuity = Discontinuity(Curve=curve_3, Level=1)  # -> Points, Parameters; disabled
list_length = ListLength(List=discontinuity.Points)  # disabled
panel = Panel("A")  # disabled
repeat_data = RepeatData(Data=panel, Length=list_length)  # disabled
point = Point(discontinuity.Points)  # disabled
text = Text(repeat_data)  # disabled

curve_4 = Curve(curve_2)  # disabled
discontinuity_2 = Discontinuity(Curve=curve_4, Level=1)  # -> Points, Parameters; disabled
panel_2 = Panel("A")  # disabled
list_length_2 = ListLength(List=discontinuity_2.Points)  # disabled
repeat_data_2 = RepeatData(Data=panel_2, Length=list_length_2)  # disabled
point_2 = Point(discontinuity_2.Points)  # disabled
text_2 = Text(repeat_data_2)  # disabled

sddp = ShapeDiverDocumentPayload({AbsoluteTolerance=0, AngleTolerance=0, DistanceDisplayPrecision=0, GltfVersion="Gltf2", GrasshopperVersion="1.0.0007", InputGroups="{}", OutputGroups="{}", RelativeTolerance=0, RhinoVersion="7.38.24338.17001", UnitSystem=0, VersionCreated="1.21.0.0", VersionSaved="1.21.0.0"})  # disabled
file_path = FilePath("D:\OneDrive\_Praca\24-25b_Semestr letni\01_AEC hackathon Zurich\_2025-AEC-Hackathon-SOURCE\json\GenericDesign_14007\14007.json")  # disabled
panel_3 = Panel("""R
C
B
B
C""")  # disabled
panel_4 = Panel("0.2")  # disabled
read_file = ReadFile(File=file_path, PerLineParse=False)  # disabled
file_path_2 = FilePath("D:\OneDrive\_Praca\24-25b_Semestr letni\01_AEC hackathon Zurich\_2025-AEC-Hackathon-SOURCE\json\GenericDesign_12005\12005.json")  # disabled
curve_5 = Curve([<curve referenced from the Rhino model> x5])  # disabled
snap_axes_vertices = SnapAxesVertices(JsonSource=read_file, SnappingThreshold=panel_4)  # -> JsonResult, OriginalLines, SnappedLines; disabled
curve_6 = Curve([<curve referenced from the Rhino model> x6])  # disabled
file_path_3 = FilePath("D:\OneDrive\_Praca\24-25b_Semestr letni\01_AEC hackathon Zurich\_2025-AEC-Hackathon-SOURCE\json\ReferenceDesign_01\Reference01.json")  # disabled
number_slider = Slider(0.05, range=0.01..10)  # disabled

# ---- group: SOURCE
text_3 = Text(panel_3)  # disabled
curve_7 = Curve(curve_5)  # disabled
list_length_3 = ListLength(List=curve_7)  # disabled
polygon_center = PolygonCenter(Polyline=curve_7)  # -> CenterV, CenterE, CenterA; disabled
panel_5 = Panel("0.5")  # disabled
divide_length = DivideLength(Curve=curve_7, Length=panel_5)  # -> Points, Tangents, Parameters; disabled
char_sequence = CharSequence(Count=list_length_3, CharPool="ABCDEFGHIJKLMNOPQRSTUVWXYZ", Format="{0}")  # disabled
panel_6 = Panel("3")  # disabled
text_tag_3d = TextTag3D(Location=polygon_center.CenterV, Text=text_3, Size=panel_6, Justification=5)  # disabled
longest_list = LongestList(ListListA=divide_length.Points, ListListB=graft(text_3), PaddingMode=2)  # -> ListListA, ListListB; disabled
text_4 = Text(flatten(longest_list.ListListB))  # disabled
point_3 = Point(flatten(longest_list.ListListA))  # disabled

# ----
find_best_orientation = FindBestOrientation(JsonSource=snap_axes_vertices.JsonResult)  # disabled
read_file_2 = ReadFile(File=file_path_2, PerLineParse=False)  # disabled
read_file_3 = ReadFile(File=file_path_3, PerLineParse=False)  # disabled
panel_7 = Panel(file_path_2)  # disabled
panel_8 = Panel("0.2")  # disabled
get_axes_from_json = GetAxesFromJson(JsonSource=find_best_orientation)  # -> Panels, Spaces; disabled
jitter_axes_vertices = JitterAxesVertices(JsonSource=read_file_2, JitterRadius=number_slider, Seed=0)  # -> JsonResult, OriginalLines, JitteredLines; disabled
panel_9 = Panel("""R
R
C
B
B
C""")  # disabled

# ---- group: TARGET
curve_8 = Curve(curve_6)  # disabled
list_length_4 = ListLength(List=curve_8)  # disabled
polygon_center_2 = PolygonCenter(Polyline=curve_8)  # -> CenterV, CenterE, CenterA; disabled
panel_10 = Panel("0.5")  # disabled
divide_length_2 = DivideLength(Curve=curve_8, Length=panel_10)  # -> Points, Tangents, Parameters; disabled
char_sequence_2 = CharSequence(Count=list_length_4, CharPool="ABCDEFGHIJKLMNOPQRSTUVWXYZ", Format="{0}")  # disabled
panel_11 = Panel("3")  # disabled
text_tag_3d_2 = TextTag3D(Location=polygon_center_2.CenterV, Text=panel_9, Size=panel_11, Justification=5)  # disabled
longest_list_2 = LongestList(ListListA=divide_length_2.Points, ListListB=graft(panel_9), PaddingMode=2)  # -> ListListA, ListListB; disabled
text_5 = Text(flatten(longest_list_2.ListListB))  # disabled
point_4 = Point(flatten(longest_list_2.ListListA))  # disabled

# ----
snap_axes_vertices_2 = SnapAxesVertices(JsonSource=read_file_3, SnappingThreshold=panel_8)  # -> JsonResult, OriginalLines, SnappedLines; disabled
average = Average(Input=point)  # disabled
find_best_orientation_2 = FindBestOrientation(JsonSource=jitter_axes_vertices.JsonResult)  # disabled
average_2 = Average(Input=point_2)  # disabled
find_best_orientation_3 = FindBestOrientation(JsonSource=snap_axes_vertices_2.JsonResult)  # disabled
number_slider_2 = Slider(0.06, range=0..1)  # disabled
vector = Vector(average)  # disabled
curve_9 = Curve([<curve referenced from the Rhino model> x4])  # disabled
vector_2 = Vector(average_2)  # disabled
get_axes_from_json_2 = GetAxesFromJson(JsonSource=find_best_orientation_2)  # -> Panels, Spaces; disabled
discontinuity_3 = Discontinuity(Curve=get_axes_from_json_2.Spaces, Level=1)  # -> flatten(Points), Parameters; disabled
convex_hull = ConvexHull(Points=discontinuity_3.Points, Plane=PlaneXY(0, 0, 0))  # -> Hull, HullZ, Indices; disabled
polyline_smallest_bounding_box = PolylineSmallestBoundingBox(Polyline=convex_hull.Hull)  # -> out, AlignedBoundingBox; inputs Polyline: Polyline; disabled
# ---------- polyline_smallest_bounding_box: C# ----------
    Component.Message = "Polyline Smallest BBox";
    if (Polyline == null)
    {
      Component.AddRuntimeMessage(
        GH_RuntimeMessageLevel.Warning,
        "Polyline parameter failed to collect data.");
      return;
    }
    if (Polyline.Count < 3)
    {
      Component.AddRuntimeMessage(
        GH_RuntimeMessageLevel.Error,
        "Cannot calculate for a Polyline with less than 3 vertices");
      return;
    }

    AlignedBoundingBox = SmallestBoxConvexHull(Polyline);
# ---------- polyline_smallest_bounding_box: C# additional code ----------
  Box SmallestBoxConvexHull(Polyline pLine)
  {
    Plane plane = Plane.WorldXY;
    Grasshopper.Kernel.Geometry.Node2List node2List = new Grasshopper.Kernel.Geometry.Node2List();
    List<Point3d> projectedVertices = new List<Point3d>();

    foreach (Point3d pt in pLine)
    {
      pt.Transform(Transform.PlanarProjection(plane));
      projectedVertices.Add(pt);
      double u, v;
      plane.ClosestParameter(pt, out u, out v);
      node2List.Append(new Grasshopper.Kernel.Geometry.Node2(u, v));
    }

    List<int> hullIndices = new List<int>();
    if (!Grasshopper.Kernel.Geometry.ConvexHull.Solver.Compute(node2List, hullIndices))
    {
      return new Box(Plane.WorldXY, pLine);
    }

    Polyline hull = new Polyline();
    for (int i = 0; i < hullIndices.Count; i++)
    {
      hull.Add(projectedVertices[hullIndices[i]]);
    }
    if (hull.Count > 1)
    {
      hull.Add(hull[0]);
    }

    hull.DeleteShortSegments(0.001);
    Line[] segments = hull.GetSegments();
    Vector3d[] directions = new Vector3d[segments.Length];
    for (int i = 0; i < segments.Length; i++)
    {
      directions[i] = segments[i].Direction;
      directions[i].Unitize();
    }

    double minArea = double.PositiveInfinity;
    Box minBox = new Box(Plane.WorldXY, pLine);

    for (int i = 0; i < directions.Length; i++)
    {
      Vector3d yAxis = Vector3d.CrossProduct(plane.ZAxis, directions[i]);
      Box curBox = new Box(new Plane(plane.Origin, directions[i], yAxis), pLine);
      double area = curBox.Area;
      if (area < minArea)
      {
        minArea = area;
        minBox = curBox;
      }
    }

    return minBox;
  }
# ---------- end polyline_smallest_bounding_box ----------
reverse = Reverse(Vector=vector)  # disabled
reverse_2 = Reverse(Vector=vector_2)  # disabled
curve_10 = Curve(jitter_axes_vertices.JitteredLines)  # disabled
panel_12 = Panel("0")  # disabled
get_axes_from_json_3 = GetAxesFromJson(JsonSource=find_best_orientation_3)  # -> Panels, Spaces; disabled
box = Box(polyline_smallest_bounding_box.AlignedBoundingBox)  # disabled
number_slider_3 = Slider(0.2, range=0.01..10)  # disabled
snap_axes_vertices_3 = SnapAxesVertices(JsonPath=find_best_orientation_2, SnappingThreshold=number_slider_3)  # -> JsonResult, OriginalLines, SnappedLines; disabled
move = Move(Geometry=point, Motion=reverse)  # -> Geometry, Transform; disabled
evaluate_box = EvaluateBox(Box=box, UParameter=number_slider_2, VParameter=number_slider_2, WParameter=panel_12)  # -> Plane, Point, Include; disabled
move_2 = Move(Geometry=point_2, Motion=reverse_2)  # -> Geometry, Transform; disabled
vector_3 = Vector(Vector(22.73120236, 24.34771549, 0))  # disabled
number_slider_4 = Slider(75, range=1..80)  # disabled
panel_13 = Panel("0.1")  # disabled
curve_11 = Curve(get_axes_from_json_2.Spaces)  # disabled
panel_14 = Panel("0.2")  # disabled
number_slider_5 = Slider(6, range=1..50)  # disabled
move_3 = Move(Motion=vector_3)  # -> Geometry, Transform; disabled
divide_length_3 = DivideLength(Curve=get_axes_from_json_3.Spaces, Length=panel_13)  # -> flatten(Points), Tangents, Parameters; disabled
panel_15 = Panel("0.1")  # disabled
divide_length_4 = DivideLength(Curve=curve_9, Length=panel_15)  # -> flatten(Points), Tangents, Parameters; disabled
panel_16 = Panel("0.00001")  # disabled
discontinuity_4 = Discontinuity(Curve=get_axes_from_json_3.Spaces, Level=1)  # -> flatten(Points), Parameters; disabled
number_slider_6 = Slider(4, range=1..60)  # disabled
number_slider_7 = Slider(3, range=1..60)  # disabled

# ----
# candidate 14012
txt = Text(["bedroom", "bathroom", "corridor", "core", "bathroom", "bedroom", "bedroom", "bedroom", "living_room"])
crv = Curve([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])
panel_17 = Panel(txt)

# ----
# candidate 21004
txt_2 = Text(["bedroom", "bathroom", "bathroom", "bedroom", "core", "living_room", "bedroom", "bedroom", "bedroom", "living_room", "bedroom", "bathroom", "bedroom"])
panel_18 = Panel(txt_2)
crv_2 = Curve([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])

transform_building_data = TransformBuildingData(JsonSource=snap_axes_vertices_3.JsonResult, Transform=move_3.Transform)  # -> JsonResult, CombinedTransforms, TransformToOriginal; disabled
align_vertices_svd = AlignVerticesSVD(Vertices=point_3, TargetVertices=point_4, MaxIterations=number_slider_4, Tolerance=panel_16)  # disabled
unit_y = UnitY(Factor=1)  # disabled

# ----
# candidate 18003
txt_3 = Text(["corridor", "bedroom", "living_room", "bedroom", "bathroom", "bathroom", "bedroom", "bedroom", "core"])
crv_3 = Curve([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])
panel_19 = Panel(txt_3)

panel_20 = Panel("0.00000000000000000000000000001")  # disabled

# ----
# reference design 01
txt_4 = Text(["living_room", "bedroom", "bathroom", "core", "corridor", "bathroom", "living_room", "bathroom", "bedroom", "bedroom", "bathroom", "corridor", "core", "bedroom", "bedroom", "bathroom", "living_room", "bathroom", "bathroom", "corridor", "corridor", "living_room", "bedroom", "corridor", "kitchen", "living_room", "bedroom", "bathroom", "core", "corridor", "bathroom", "living_room", "bathroom", "bedroom", "bedroom", "bathroom", "corridor"])
crv_4 = Curve([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])
panel_21 = Panel(txt_4)

# ----
# candidate 12005
txt_5 = Text(["living_room", "bathroom", "core", "bedroom", "bedroom", "bedroom", "bedroom"])
crv_5 = Curve([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])

# ----
# candidate 12009
txt_6 = Text(["living_room", "corridor", "core", "bedroom", "bedroom", "bathroom", "bathroom"])
crv_6 = Curve([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])

# ----
# candidate 12001
txt_7 = Text(["bathroom", "bedroom", "bedroom", "bedroom", "living_room", "core", "bathroom", "bedroom", "corridor", "bedroom"])
crv_7 = Curve([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])
panel_22 = Panel(txt_7)

# ----
# candidate 14007
crv_8 = Curve([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])
txt_8 = Text(["living_room", "bedroom", "core", "bedroom", "bedroom", "bathroom", "bathroom"])
panel_23 = Panel(txt_8)

weighted_svd_alignment = WeightedSVDAlignment(Vertices=move_2.Geometry, Labels=text_2, TargetVertices=move.Geometry, TargetLabels=text)  # disabled
polygon_center_3 = PolygonCenter()  # -> CenterV, CenterE, CenterA; disabled
curve_12 = Curve(snap_axes_vertices_3.OriginalLines)  # disabled
align_vertices_svd_weighted = AlignVerticesSVDWeighted(
    Vertices=point_3,
    Labels=text_4,
    TargetVertices=point_4,
    TargetLabels=text_5,
    MainIterations=number_slider_6,
    InterimIterations=number_slider_7,
    Tolerance=1e-05)  # disabled
curve_13 = Curve(snap_axes_vertices_3.SnappedLines)  # disabled
angle = Angle(VectorA=unit_y)  # -> Angle, Reflex; disabled
rotate = Rotate(Geometry=curve_10, Angle=angle.Angle, Plane=PlaneXY(0, 0, 0))  # -> Geometry, Transform; disabled
discontinuity_5 = Discontinuity(Curve=curve_9, Level=1)  # -> flatten(Points), Parameters; disabled
custom_preview = CustomPreview(Material={diffuse=RGB(221, 160, 221), emission=RGB(66, 48, 66), shine=0.5, specular=RGB(255, 255, 255), transparency=0})  # disabled
number_slider_8 = Slider(23, range=1..75)  # disabled
panel_24 = Panel("a")  # disabled
panel_25 = Panel("a")  # disabled
clean_tree = CleanTree(RemoveNulls=True, RemoveInvalid=True, RemoveEmpty=False, Tree=curve_13)  # disabled
transform = Transform(Geometry=curve_5, Transform=align_vertices_svd)  # disabled
transform_building_data_2 = TransformBuildingData(JsonSource=transform_building_data.JsonResult, Transform=transform_building_data.TransformToOriginal)  # -> JsonResult, CombinedTransforms, TransformToOriginal; disabled
list_item = ListItem(List=rotate.Transform, Index=0, Wrap=True)  # disabled
panel_26 = Panel(angle.Angle)  # disabled
inverse_transform = InverseTransform(Transform=move.Transform)  # disabled
list_length_5 = ListLength(List=divide_length_3.Points)  # disabled
list_length_6 = ListLength(List=divide_length_4.Points)  # disabled
number_slider_9 = Slider(1, range=0..1)  # disabled
transform_2 = Transform(Geometry=move_2.Geometry, Transform=weighted_svd_alignment)  # disabled
panel_27 = Panel("0.05")  # disabled
repeat_data_3 = RepeatData(Data=panel_24, Length=list_length_5)  # disabled
panel_28 = Panel("0.000000001")  # disabled
transform_building_data_3 = TransformBuildingData(JsonSource=jitter_axes_vertices.JsonResult, Transform=list_item)  # -> JsonResult, CombinedTransforms, TransformToOriginal; disabled
repeat_data_4 = RepeatData(Data=panel_25, Length=list_length_6)  # disabled
panel_29 = Panel(snap_axes_vertices_3.SnappedLines)  # disabled
mesh_pipe = MeshPipe(Curve=clean_tree, Radius=panel_27, Accuracy=0.2, Rotation=0, Segments=10, Caps=2)  # disabled
graph_mapper = GraphMapper(
    number_slider_9,
    x0=0,
    x1=1,
    y0=0,
    y1=1,
    container_name="Bezier",
    cpx=[0, 0.1973080784, 0.5256046653, 1],
    cpy=[0, 0.6326568127, 1, 1])  # disabled
slide_within_transform = SlideWithinTransform(Transform=align_vertices_svd_weighted, Factor=graph_mapper)  # disabled
transform_3 = Transform(Geometry=curve_5, Transform=slide_within_transform)  # disabled
curve_14 = Curve()  # disabled
get_axes_from_json_4 = GetAxesFromJson(JsonSource=transform_building_data_2.JsonResult)  # -> Panels, Spaces; disabled
transform_4 = Transform(Geometry=transform_2, Transform=inverse_transform)  # disabled
panel_30 = Panel("""living_room
bedroom
bathroom
core
corridor
bathroom
living_room
bathroom
bedroom
bedroom
bathroom
corridor
core
bedroom""")
weighted_svd_alignment_2 = WeightedSVDAlignment(Vertices=divide_length_4.Points, Labels=repeat_data_3, TargetVertices=divide_length_3.Points, TargetLabels=repeat_data_4)  # disabled
transform_5 = Transform(Geometry=curve_9, Transform=weighted_svd_alignment_2)  # disabled
transform_building_data_4 = TransformBuildingData(JsonSource=find_best_orientation, Transform=weighted_svd_alignment_2)  # -> JsonResult, CombinedTransforms, TransformToOriginal; disabled

# ----
# candidate 11001
txt_9 = Text(["bathroom", "bedroom", "core", "corridor", "living_room", "bathroom", "bedroom", "bedroom"])
crv_9 = Curve([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])
panel_31 = Panel(txt_9)

polyline = PolyLine(Vertices=transform_4, Closed=False)  # disabled

# ----
# reference design 02
crv_10 = Curve([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])
txt_10 = Text(panel_30)
panel_32 = Panel(txt_10)

curve_15 = Curve(transform_3)  # disabled
text_6 = Text(text_3)  # disabled
list_length_7 = ListLength(List=curve_15)  # disabled
polygon_center_4 = PolygonCenter(Polyline=curve_15)  # -> CenterV, CenterE, CenterA; disabled
panel_33 = Panel("0.1")  # disabled
divide_length_5 = DivideLength(Curve=curve_15, Length=panel_33)  # -> Points, Tangents, Parameters; disabled
char_sequence_3 = CharSequence(Count=list_length_7, CharPool="ABCDEFGHIJKLMNOPQRSTUVWXYZ", Format="{0}")  # disabled
panel_34 = Panel("3")  # disabled
text_tag_3d_3 = TextTag3D(Location=polygon_center_4.CenterV, Text=text_6, Size=panel_34, Justification=5)  # disabled
longest_list_3 = LongestList(ListListA=divide_length_5.Points, ListListB=graft(text_6), PaddingMode=2)  # -> ListListA, ListListB; disabled
text_7 = Text(flatten(longest_list_3.ListListB))  # disabled
point_5 = Point(flatten(longest_list_3.ListListA))  # disabled

panel_35 = Panel("""R
C
B
B
C""")
transform_building_data_5 = TransformBuildingData(JsonSource=transform_building_data_3.JsonResult, Transform=move_3.Transform)  # -> JsonResult, CombinedTransforms, TransformToOriginal; disabled
get_axes_from_json_5 = GetAxesFromJson(JsonSource=transform_building_data_4.JsonResult)  # -> Panels, Spaces; disabled
curve_16 = Curve(crv_9)
get_axes_from_json_6 = GetAxesFromJson(JsonSource=transform_building_data_5.JsonResult)  # -> Panels, Spaces; disabled
curve_17 = Curve(get_axes_from_json_6.Spaces)  # disabled
get_axes_from_json_7 = GetAxesFromJson(JsonSource=transform_building_data_3.JsonResult)  # -> Panels, Spaces; disabled
transform_building_data_6 = TransformBuildingData(JsonSource=transform_building_data_5.JsonResult, Transform=transform_building_data_5.TransformToOriginal)  # -> JsonResult, CombinedTransforms, TransformToOriginal; disabled

# ----
# CANDIDATE
file_path_4 = FilePath("D:\OneDrive\_Praca\24-25b_Semestr letni\01_AEC hackathon Zurich\_2025-AEC-Hackathon-SOURCE\json\GenericDesign_14012\14012.json")

# ----
# REFERENCE
file_path_5 = FilePath("D:\OneDrive\_Praca\24-25b_Semestr letni\01_AEC hackathon Zurich\_2025-AEC-Hackathon-SOURCE\json\ReferenceDesign_01\Reference01.json")

curve_18 = Curve(get_axes_from_json_7.Panels)  # disabled
number_slider_10 = Slider(140.39, range=0..360)
point_6 = Point(Point(4.667086846, 5.432836604, 0))
read_file_4 = ReadFile(File=file_path_4, PerLineParse=False)
read_file_5 = ReadFile(File=file_path_5, PerLineParse=False)
rotate_2 = Rotate(Angle=degrees(number_slider_10), Plane=point_6)  # -> Geometry, Transform
find_best_orientation_4 = FindBestOrientation(JsonSource=read_file_4)
find_best_orientation_5 = FindBestOrientation(JsonSource=read_file_5)
get_spaces_data_from_json = GetSpacesDataFromJson(JsonSource=find_best_orientation_4)  # -> Spaces, Labels
snap_axes_vertices_4 = SnapAxesVertices(JsonSource=find_best_orientation_4, SnappingThreshold="0.2")  # -> JsonResult, OriginalLines, SnappedLines
transform_building_data_7 = TransformBuildingData(JsonSource=snap_axes_vertices_4.JsonResult, Transform=rotate_2.Transform)  # -> JsonResult, CombinedTransforms, TransformToOriginal
snap_axes_vertices_5 = SnapAxesVertices(JsonSource=find_best_orientation_5, SnappingThreshold="0.2")  # -> JsonResult, OriginalLines, SnappedLines
get_spaces_data_from_json_2 = GetSpacesDataFromJson(JsonSource=transform_building_data_7.JsonResult)  # -> Spaces, Labels
number_slider_11 = Slider(14, range=0..14)
move_back_to_original_orientation = MoveBackToOriginalOrientation(JsonSource=snap_axes_vertices_5.JsonResult)  # -> JsonResult, AppliedTransform
move_back_to_original_orientation_2 = MoveBackToOriginalOrientation(JsonSource=snap_axes_vertices_4.JsonResult)  # -> JsonResult, AppliedTransform
curve_19 = Curve(snap_axes_vertices_4.SnappedLines)
number_slider_12 = Slider(7, range=0..14)
get_spaces_data_from_json_3 = GetSpacesDataFromJson(JsonSource=snap_axes_vertices_5.JsonResult)  # -> Spaces, Labels
split_list = SplitList(List=get_spaces_data_from_json_2.Labels, Index=number_slider_11)  # -> ListA, ListB
split_list_2 = SplitList(List=get_spaces_data_from_json_2.Spaces, Index=number_slider_11)  # -> ListA, ListB
curve_20 = Curve(<curve referenced from the Rhino model>)
curve_21 = Curve(<curve referenced from the Rhino model>)
split_list_3 = SplitList(List=get_spaces_data_from_json_3.Labels, Index=number_slider_12)  # -> ListA, ListB
split_list_4 = SplitList(List=get_spaces_data_from_json_3.Spaces, Index=number_slider_12)  # -> ListA, ListB

# ---- group: SOURCE
curve_22 = Curve(curve_20)
text_8 = Text("Room")
list_length_8 = ListLength(List=curve_22)
polygon_center_5 = PolygonCenter(Polyline=curve_22)  # -> CenterV, CenterE, CenterA
divide_length_6 = DivideLength(Curve=curve_22, Length="0.5")  # -> Points, Tangents, Parameters
char_sequence_4 = CharSequence(Count=list_length_8, CharPool="ABCDEFGHIJKLMNOPQRSTUVWXYZ", Format="{0}")
text_tag_3d_4 = TextTag3D(Location=polygon_center_5.CenterV, Text=text_8, Size="0.4", Justification=5)
longest_list_4 = LongestList(ListListA=divide_length_6.Points, ListListB=graft(text_8), PaddingMode=2)  # -> ListListA, ListListB
text_9 = Text(flatten(longest_list_4.ListListB))
point_7 = Point(flatten(longest_list_4.ListListA))

# ---- group: TARGET
curve_23 = Curve(curve_21)
text_10 = Text("Room")
list_length_9 = ListLength(List=curve_23)
polygon_center_6 = PolygonCenter(Polyline=curve_23)  # -> CenterV, CenterE, CenterA
divide_length_7 = DivideLength(Curve=curve_23, Length="0.5")  # -> Points, Tangents, Parameters
char_sequence_5 = CharSequence(Count=list_length_9, CharPool="ABCDEFGHIJKLMNOPQRSTUVWXYZ", Format="{0}")
text_tag_3d_5 = TextTag3D(Location=polygon_center_6.CenterV, Text=text_10, Size="0.4", Justification=5)
longest_list_5 = LongestList(ListListA=divide_length_7.Points, ListListB=graft(text_10), PaddingMode=2)  # -> ListListA, ListListB
text_11 = Text(flatten(longest_list_5.ListListB))
point_8 = Point(flatten(longest_list_5.ListListA))

# ----
panel_36 = Panel("""R
R
C
B
B
C""")
number_slider_13 = Slider(8, range=1..30)
number_slider_14 = Slider(2, range=1..10)
align_vertices_svd_weighted_2 = AlignVerticesSVDWeighted(
    Vertices=point_7,
    Labels=text_9,
    TargetVertices=point_8,
    TargetLabels=text_11,
    MainIterations=number_slider_13,
    InterimIterations=number_slider_14,
    Tolerance=1e-05)
align_vertices_svd_2 = AlignVerticesSVD(Vertices=point_7, TargetVertices=point_8, MaxIterations=Slider(80, range=1..80), Tolerance="0.00001")
graph_mapper_2 = GraphMapper(
    Slider(1, range=0..1),
    x0=0,
    x1=1,
    y0=0,
    y1=1,
    container_name="Bezier",
    cpx=[0, 0.1973080784, 0.5256046653, 1],
    cpy=[0, 0.6326568127, 1, 1])
slide_within_transform_2 = SlideWithinTransform(Transform=align_vertices_svd_weighted_2, Factor=graph_mapper_2)
transform_building_data_8 = TransformBuildingData(JsonSource=transform_building_data_7.JsonResult, Transform=slide_within_transform_2)  # -> JsonResult, CombinedTransforms, TransformToOriginal
transform_6 = Transform(Geometry=curve_22, Transform=align_vertices_svd_2)
transform_7 = Transform(Geometry=curve_22, Transform=slide_within_transform_2)
get_spaces_data_from_json_4 = GetSpacesDataFromJson(JsonSource=transform_building_data_8.JsonResult)  # -> Spaces, Labels
match_spaces = MatchSpaces(SpacesSource=transform_7, LabelsSource=text_8, SpacesTarget=curve_23, LabelsTarget=text_10)  # -> SpacesA, SpacesB, PointPairs
line = Line(flatten(match_spaces.PointPairs))
number_slider_15 = Slider(1, range=0..10)
length = Length(Curve=line)
mass_addition = MassAddition(Input=length)  # -> Result, PartialResults

curve_24 = Curve(transform_7)
text_12 = Text(text_8)
list_length_10 = ListLength(List=curve_24)
polygon_center_7 = PolygonCenter(Polyline=curve_24)  # -> CenterV, CenterE, CenterA
divide_length_8 = DivideLength(Curve=curve_24, Length="0.1")  # -> Points, Tangents, Parameters
char_sequence_6 = CharSequence(Count=list_length_10, CharPool="ABCDEFGHIJKLMNOPQRSTUVWXYZ", Format="{0}")
text_tag_3d_6 = TextTag3D(Location=polygon_center_7.CenterV, Text=text_12, Size="0.4", Colour=RGB(0, 0, 0), Justification=5)
longest_list_6 = LongestList(ListListA=divide_length_8.Points, ListListB=graft(text_12), PaddingMode=2)  # -> ListListA, ListListB
text_13 = Text(flatten(longest_list_6.ListListB))
point_9 = Point(flatten(longest_list_6.ListListA))

list_item_2 = ListItem(List=match_spaces.SpacesA, Index=number_slider_15, Wrap=True)
tree_branch_index = TreeBranchIndex(DataTree=match_spaces.PointPairs, BranchIndex=number_slider_15)
list_item_3 = ListItem(List=match_spaces.SpacesB, Index=number_slider_15, Wrap=True)
number = Number(mass_addition.Result)
expression = Expression(x=number, Expression="Format(\"{0:0.00}\", x)")
concatenate = Concatenate(FragmentA="Score: ", FragmentB=expression)
point_10 = Point(Point(23.10415858, -8.417583165, 0))
text_tag_3d_7 = TextTag3D(Location=point_10, Text=concatenate, Size="0.4", Justification=7)
galapagos = Galapagos(fitness=number, gene=[number_slider_14, number_slider_13, number_slider_10])
